# Grasshopper definition 12_garden_fence.gh (Grasshopper 1.0.8)
# plug-ins: RhinoCodePluginGH, treesloth01, ShapeDiverForGrasshopper, eleFront, NGon_RH8

sddp = ShapeDiverDocumentPayload({AbsoluteTolerance=0, AngleTolerance=0, DistanceDisplayPrecision=0, GltfVersion="Gltf2", GrasshopperVersion="1.0.0008", InputGroups="{}", OutputGroups="{}", RelativeTolerance=0, RhinoVersion="8.12.24282.7001", UnitSystem=0, VersionCreated="1.21.0.0", VersionSaved="1.21.0.0"})
# Example0
panel = Panel("""AAAA
BBCD
BBCC
EEEC""")
# Example2
panel_2 = Panel("""RRRRIICCFF
RRRRIICCCF
VVRRRCCFFF
VVRCCCJFFF
VVVVCJJCFE
VVIVCCJJEE
VVIIICJJEE
MIIIIIJJEE
MIIISIJEEE
MMMISSJEEE""")
# Example1
panel_3 = Panel("""OOOOO
OXOXO
OOOOO
OXOXO
OOOOO""")
# RealInput
panel_4 = Panel("""SSSSSSSSSSSSSSSWWWWWHHHHHHHHHHHHHHHHHHBBBJJJJJJJJJIJUUUUUUUUUOOOOOOOOOHHHHHHHHHGGGGGGGGGGGGGGGGTTTTTTTTTTZZZHHSSHHHEEEEEEEETTTTTTTTTTOOOOOOO
SSSSSSSSSSSSSSSWWWWWWHHHHHHHHHHHHHHHHHBBJJJJJJJJJJJJUUUUUUUOOOOOOOOOOOOHHHHHHHHHGGGGGGGGGGTTTGTTTTTTTTTTZZHHHSSSHHEEEEEEEEETTTTTTTTTTTTOOOOO
SSSSSSSSSSSSAAWWWWWWWBBBBHBBBHHHHHHHHHJJJJJJJJJJJJJUUUUUUUPOCOOOOOOOOOOHHHHHHHHHGGGGGGGGGGGTTTTTTTTTTTTTZHHHHHHSHHHHEEEEEEETTTTTTTTTTTOOOOOO
SSSSSSSSSSSSAAAAAWRWBBBBBBBBBHHHHHHHHHJJJJJJJJJJJJJJUUUPPPPPPSOOOOOOOOOHOOOOHHHGGGGGGGGGGGGTTTTTTTTTTTTTHHHHHHHHHHHHBBEEEEETTTTTTTTTTTTOOOOO
SSSSSSSSSSAAAAAAAWRWWBBBBBBHHHHHHHHHHHJJJCJJJJJJJJJJUUUUPPPPPOOOOOOOOOOOOOOOHHHGGGGGGGGGGGGTTTTTTTTTTTTTHHHHHHHHHHHBBBBBEEETTTTTTTTOOOOOOOOO
SSSSSSSSAAAAAAAARRRWBBBBBBBHHHHHHHHHHHJJJJJJJJJJJJJJUUUUPPPPPOOOOOOOOOOOOOOOHGHGGGGGGGGGGGGETTTTTTTTTTTTHHHHHHHHEHHBBBBBEEEEEOHTTTTOOOOOOOOO
SSSSSSSAAAAAAAARRRRBBAABBBZZHHHHHHHHCCXXJJJJJJJJJJUUUUUUPPPPPPPOOOOOOOOOOOOOGGGBGGGGGGGGGGGETTTTTTTTTTTTHHGGGHHHHBBBBBBBEEEEEOOTOTOOOOOOOOOO
SSSSSSSSAAAAAAARRRKBBAABBBEZHHHHHHHHHXXXJJJJJJJJJUUUUUUPPPUPPPPOOPOOOOOOOOSGGGGGGGGCGGGFFQFETTTTTTTTTTTPHHGGGGGHGBBBBBBBBEEEOOOOOOOOOOOOOOOO
SSSSSSSSSAAKKAAARRRAAAAAEEEEEHEHXHHHHXXXJXJXJJJJJUUUUUUUUUUPSPPOOPPOOOOOOOOOGGGGGGGGGLFFFQFTTTTTTTTTTTTPGGGGGGGGGBBBBBBEEEEEEEOUOOOOOOOOOOOO
CSSSSSSSSSSKAAAARRAAAAAAEEEEEEEXXXHHHXXXXXXXXJJJJJJUUUUUUUUUUUUUUUUUUOOOOOOGGGGGGGGGFFFFFFFTTTTTTTXTTTTLLGGGGGGGGGBBBEEEEEEEEOOUOOOOOOOOOOOO
CSSSSSSSSSKKKAAAAAAAAAAAEEEEEEEXXXHHXXXXXXXXXJJJJGGUUUUUUUUUUUUUUUUUUOOOOGGGGGGGGGGFFFFFFFFFFTTTTTTTLLTLGGGGGGGGGGBBBEPEEEEEPXXOOOOOOOOXXOOO
CSSSSSSSSKKKKAAAAAAAAEEEEEEEEPPEXXHXXXXXXXXXJJJJJJUUUUUUUSSUUUUUUUUUUOHHOGGAGGGGGGGFFFFFFFFFFTTGGGHHLLLLLLGGGGGGGGMBBPPEEEEEPPPPSOOOOOOXXXXX
CMSSSSSSSKKKKKKAAAAAAAEEEEEEPPPEEXXXXXXXXXXHUUJFFJUUUUUUSSSUUUUUUUUUUAAAAAAAGGGGEEEEEEFFFFFFFFFRRRRHHLLLLLLLGGGGGGGBBPPPPPPPPPPFOOOOXXXXXXXX
CCKSSSSSQQQKKKKAAAAAAAZEEEEEEEEEEEXXXXXXXXXHHHFFFUUUUUUUUUUUUUUUUUUUUAAAAAAAGGGGEEEEEEFFFFFFFFFRRRRRHLLLLLLLGGGGGGGGGGPPPPPPPPPWOOOXXXXXXXXX
CCKSSSSQQQQKKKKKAAAAZAZEEEEEEEEEEXXBXXXXXXXHLHHUUUUUUUUUUUUUUUUUUUUUUAAAAAGGGEEEEEEEEEEFFFFFFFFRRRRRHLLLLLGGGGGGGGGGGPPPPPPPPPWWOOOOXXXXXXXX
KCKKKKKKKKKKKKKKAAAAZZZEZEEEEEEEGBBBBXXXXHHHHHUUUUUUUUUUUUUUUUUUUUUUUAAAEEEEEEEEEEEEEEEEEEFFFFFHHHHHHHLLLLLLGGGGGGGPPPPPPPPPPPWWWOOOXXXXXXXX
KKKKKKKKKKKKKKKKAAAAZZZZZZEEEEGGGBBBBBBBXHHHHHHHUUUUUUUUUUUUUUUUUUUUUANAEEEEEEEEEEEEEEEEEEFFFFFHHHHLLHLLLLLLGGGGGJGTRYPYPPPPPWWVWWWXXXXXXXXX
KKKKKKKKKKKKKKKAAAAZZZZZZZEEEEGGBBBBBBBHHHHHHHHUUURCUUUUUUUUUUUUUUUUUAAJEEEEEEEEEEEEEEEEEEFFFHHHHHHLLLLLLLLLGGGGGJRRRYYYPPPWWWWWWWWXXXXXXXXN
KKKKKKKKKKKKKVKAAAAZZZZZZNEEEEGGBNBBBBBBBHHHHHHUURRCUUUUUUUUUUUUUUUUUJJJEEEEEEEEEEEEEEEEEEFHHHHHRHRILLLLLLLLGGGGGRRRRYYYYPWWWWWWWWWXUXXXPXNN
KKKKKKKKKEKEKKKAAAAZZZZZZEEEEGGBBBBBBBBBGGHHHHHHFCCCUUUUUUUUUUUUUUAAJJJJEEEEEEEEEEEEEEEEEEXHHHHHRRRRLLLLLLLLGGGGIRRRRYYYYPWWSWWWWWWWUUUUUUUN
KKKKYYKEEEEEKKKKAAAAZZZZZEEENNGBBLBSBBBBBGGBBHHBFFCCCVNNUUUUUUUNNAAJJJJJEEEEEEEEEEEEEEEFFFXXXHXXXRRRLLLLLLLLLLLYYYRRRYYYYPWYYWWWWWWUUUUUUUUN
KKKYYYKEEXEXXRKKKKIZZZZZZPEENNBBLLLBBBBBBGGBBBHBFCCCCCNNUUUUUUUNNAJJJJJJEEEEEEEEEEEEEEERXXXXXXXXXRRRLLLLVRLLYYYYYYRRRYYYYYYYYWWWWWWUUUUUUUUN
KRRYYYXXXXXXXXKKKKZZZZZZZZZZHHHHHLBBBBBBBBBBBBBBBFNNNNNNUUUUUUUNNJJJJJJJEEEEEEEEEEEEEEERRXXXXXXXXRRRRRLRRRRLLYYYYYYYYYYYYYYYYYWWWCCUUUUUUUUU
RRYYYXXXXXXXKKKKKKKZZJZZZZZZHHHHHBBBBBBBBBBBBBBFFFNNNNNNNNNUUUNNNJJJJJJJEEEEEEEEEEEEEEERRXXXXXXXXRRRRRRRRRRRLKYYYYYYYYYYYCYYYWWWWCKUUUUTTTTT
RRRYYXXXXXXXXXKKKKKZZJZZZZZZZHHHHBBBBBBBBBBBBFFFFFNNNNNNNNNNNNNNNJJJJJJJJCCCCDDEEEDDXXXXXXXXXXXXRRRRRRRRRRRRLKYYYYYYYYYYYCCCCCCWCCKUUTTTTTTT
YYYYLLXXXXXXXXKKKKKKZZZZZZZZHHHHBBBBBBBBBBBBBBFFFFNNNNNNNNNNNNNNNJJJJJJCCCCCDDDEEEDBBBYXXXXXXXXRRRRRRRRRRRRRLRYYYYYYYYYYYCCCCCCCCCCCUTTTTTTT
LLYLLLXXXXXXXKKKKKKKZZZZZZZZHHHBBBBBBBBBBBBBFFFFFFNNNNNNNNNNTTTTJJJJJJJCCCCDDDDDDDDDDBYYXXXXXXXRRRRRRRRRRRRRRRYYYYYYYYYYYYCCCCCCCCCCCTTTTTTT
LLLCLLLXXXXXXKKKKKKKZZZZZZZHHHHBBBBBBBBBBBBBFFFFFFNNNNNNNNNNTTTTDDDDDJJJJJCDDDDDDDDDDYYYXXXXXWRRRRRRRRRRRRRPPPYYDYYYYYYYYYYCCTCCCCCCCTTTTTTT
LLLLLLXXXXXXXKKKKKKKZZZZZZZZHHHBBBBBBBBBBBBFFFFFFLLLLLLLLLNNTTTTDDDDDJJJJJCDDDDDDDDDYYYYYYYYYRRRRRRRRRRRRRRRRPDDDDDDYYYYYYYYTTCCCCCCCTTTTTTT
LLLLLYYYXXXXXKKKKKHKZZZHHHHHHHBBBBBBBBBBBBBFFFFFLLLLLLLLLLNNTTTDDDDDDAJJJCCDDDDDDDDDDDYYYYYYYRPYWWRRRRRRRRCCRRDDDDDDYYYYYYYYTCCCCCCCCTTTTTTT
LLLLYYYYYYXXXKKKKKHHZZZHHHHHHHHHHBBBBBBBBBBZZFFFLLLLLLLLLLETETTDDDDDDAAAADDDDDDDDDDDDDYYYYYYYYPYWRRRRRRRRRCCCCCDDDDDDYYDYYYYTTCCCCCCCTTTTTTT
LLLYYYYYYYKXXKKJJHHHHZZHHHHHHHHHHHHBBBBYBBBZWHFFLLLLLLLLLLEEEEEEEDDDDDDADDDDDDDDDDDDDDYYYYYYYYYYWRRRRRRRRCCCCCCDDDDDDDDDYYDDCCCCCCCCGTTTTTTT
LLLLYYYYYYKKKKKJJHTHHHHHHHHHHHHHHHHOBBBYYBBZWHHHLLLLLLLLLLEEEEEEDDDDDDAADDDDDDDDDDDDDDYYKYYYYYYYYYRRRRRCCCCCCCCCDDDDDDDYYYDDDCCCCCCCGTTTTTTT
LLLLLYYYYYKKKKJJNHHHHHHHHHHHHHHHHHHONNNNNNNNWHAALLLLEEEEEEEEEEEEDDDDDAAAAAADDDDDDFFDDDDFFYYYYYYYYYRRRRQCCCCCCCPPPPPDDDDDYYDTTTTTTTTGGGTTTTTT
LLLLYYYYYYYZZJJJHHHHHHHIHHHHHHHHHOOONNNNNNNNWWAALLLLEAEEEEEEEEEEDDDDDDDTTTTDTDDDDFFDFFFFFNNYYYYYYLLLRCCCCCCCCCPPPPPPPDDDDDDTTTTTTTTTTTTTTTTT
LLLYYYYYYBZZZVZJJJJJJHHIIIHHHOHHOOOONNNNNNNNWAAALLLLAAEEEEEEEJEEDDDDDDDTTTTTTTDDDFFFFFFFFFNYYYYYYLLLLLCCCCCCCPPPPPPPPDDDDDDTTTTTTTTTTTTTTTTT
LLLYYYYYYBBZZZZJJJJHHHHIIIHHHOOOOOOONNNNNNNNWWAALLLLAAAEAEEEEEEEDYDDDTTTTTTTTPPDZFFFFFFFFFFUUUUYYLLLLLLCCCCCPPPPPPPPPDDDNNNNNNNTTTTTTTTTTTTT
LLYYYYYYYBBZZZZZJJJJJIHIIHHHHOOOOOOONNNNNNNNWWWWLLLLAAAAAAEYEEEEEYYYDTTTTTTTTPPAZFFFFFFFFFFUUUUYYYLLLCCCCPPPPPPPPPPPPPDXNNNNNNNTTTTTTTTTGGGX
LLLYYYYYBBZZZZZZJJJJIIIIIHHHHHHOOOOONNNNNNNNWWWWAAAAAAAAAAEEEHEEEYYYTTYTTTAAAPAAZFFFFFFFFFFFUUUYYYLLLCLLPPPPPPPPPPPPPPDXNNNNNNNNNTTTTTTTGGGX
LLLLLYYYYYZZZZZZJJJIIIIIIIIIHFHODOOONNNNNNNNAWWWAAAAAAAAAHHHEHHHEYYYYYYTTSAAAAAWFFFFFFFFFFFFUUUYYYLLLLLLPPPPPPPPPPPPYPDXNNNNNNNNNTTTTTTTGGXX
LLLLLLLYJJJJZZJJJJJIIIIIIIIIIFFFOOOOOONNNAAAWWWWWAAAAAAAAHHHHHHHEEYYYYYYYYAAAAAAAFFFFFFFFFFUUUURRLLLLLLLLPPPPPPPPPPPPPDPNNNNNNNNNTTTTTTTGGBB
LLLLLLLLLJJJZZJJJJJIIIIIIIIIIFFFOOOOOONNNOATTWWWWAAAAAAFFHHHHHHHYYYYYYYZYAAAAAAAAAFKFFFFFFFFFRRRRLLLLLLLLPPPPPPPPPPPNNNNNNNNNNNNNTTTTTTTGNBB
LLLLLLLBLJJJJJJJJJJIIIIIIIIIIFFFOOOOOONNNTTTTWWWWWAAAHHHHHHHHHHHYYYYYXZZZZZZAAAAAAFFFFFFFFRFRRRRRLLLLLLLLLLPPPPPPPPPNNNNNNNNNNNNNNBBBBBBGBBB
LLLLLLLLHHHJJJJJJCCCIIIIIIIIIIIFFFOOHHNNNOTTTWWWWWWLLSHHHHHHHHHYYYYYYXZZZZZZAAUAAAAFFFFFBFRRRRRRRRLYLLLLLPLPPPPPPPPPNNNNNNNNNNNNNNBBBBBBBBBB
LLLLLLLHHHHJJJJJJJCCIIIIIIIXIIIIFFFOFHNNNTTTTTTTTWWLLHHHHHHHHHHYYYYYYXZZZZZZZAAAAAAAAFFBBFRRRRRRRRLYYLLLLPPPPPPPPPPPNNNNNNNNNNNNNNBBBBBBBBBB
HLLLLLHHHHHHJHJJCCCCCCIIIIIXIIIFFFFFFFNNNTTTTTTTTTTLLHLHHHHHHHHVVVYXXXXXZZZZZJJJAJDDDFBBBFRRRRRRRRYYYLLLLPPPPPPPCPPPNNNNNNNNNNNNNNBBBBBBBBBB
HHHHLHHHHHHHHHJJCCCCCCTIXXXXXFFFFFFFFFTTTTTTTTTTTLLLLLLHHVHHVHVVVVXXSSSXSSZZZZZJJJJDFFDDBFRRRRYYYYYYYLLLPPPPPPPCCPCCAAAAANNNNNNNNNBBBBBBMHHH
HHHHHHHHHHHHHHHHBCCCCFCIIXXXXXFFFFFFFFTTTTTTTTTTLLLLLLXHHVVVVVVVVVVVSSSSSSSZZZZZJDDDFDDDDDDRRDAYLLLLLLLLPPPPPPPCCCCAAAAAANNNNNNNNNBBBMMBMHHH
HHHHHHHHHHHHHHHBCCCCCCCCCCXXXIIIIIIIIITTTTTTTTTTLLLLLLLVHVVVVVVVVVVDSSSSSSSZZZZZZZDDDDDDDDDDDDDLLLLLLLPPPPPPPPPPCCCAAAAAAAAAAAABBBBBBBMMMHHH
HHHHHHHHHHHHHHBBBCCCCIIIIIIIIIIIIIIIIITTTTTTLLLLLLLLLLLVVVVVVVVVVSSSSSSSSSSVSZZZZZDDDDDDDDDDDDLLLLLZLLPPPPPPPPPPPAAAAAAAAAAAAAABMMMMMMMMMMHH
HHHHHFHHHHHHHBBBBBCCCIIIIIIIIIIIIIIIIITTLLLLLLLLLLLLLLLVMVVVVVVVVSSSSSSSSSSSSZZZZZDDDDDDDDDDDDDLLLLZZLPPPPPPPPPPPAAAAAAAAAAAAAAAMMMMMMMMMMMM
CCFFFFHHHHHBBBPBBBBCCIIIIIIIIIIIIIIIIITTTTLLLLLLLLLLLVVVMVVVVVVSSSJSSSSSSSSSSUZZIZDDDDDDDDDDDKKKLLZZLLLPPPPPPPPPOAAAAAAAAAAAAAAAMMMMMMMMMMMM
CCFFFFFHHHHJBBBBBBCCCIIIIIIIIIIIIIIIIITVVVVLLLLLLLLLLLLVVVVVVVVVVSSSSSSSSSSSZUUZIIDDDDDDDDDDKKKKLZZZZKKKKPPPPZPPOOOAAAAAAAAAAAAAMMMMMMMMMMMM
CFFFFFFHHHHHBBBBBBBCCIIIIIIIIIIIIIIIIIZVVVVLVLLLLLLBLLLVIVVVVVVVSSSSSSSSSSSSUUUUUDDDDDDDDDDKKKKKKKKKZZAKKPPZZZZOOOOOAAAAAAAAAMMMMMMMMMMMMMMM
CFFFFFFHHHHHBBBBBXBBCIIIIIIIIIIIIZZZZZZVVVVVVLLLLLLBBIIIIVVVVVVSSSSSSSSSSSSSUUUUUUUDDDDDDDDKKKKKKKKKKKKKZZZZZZZZOOOOAAAAAAAAAAMAMMMMMMMMMMMM
FFFFFFFFFHHFFBBBXXBBIIIIIIIIIIIIIZZZZVVVVVVVLLLLLLLLBBIIIIVVPVVSSSSSSSSSSUUUUUUUUUUDDDDDDDDDDKKKKKKKKKKKZZZZZZZZOOOOOOAAAAAAAAAAMMMMMMMMMMMM
FFFFFFFFUFFFBBBBBBBBIIIIIIIIIIIIIZZZZVVVVVVVLLLLLLLBBBBIIIPUPVPKSSSSSSSSSSUUUUUUUUUDDDDDDDDDPKKKKKKKKKKKKZZZZZZOOOOOOOAAAAAAVVAAMMMMMMMMMMMM
FFFFFFFFFFBBBBBBBBJJIIIIIIIIIIIIIZZZZZVVVVVVVLLLLLLLBBIIIPPPPPPSSSSSSSSSUUUUUUUUUUUDDDDDDDDDPPPKKKKKKKKKKZZZZZZOOOOOOOTTHAAVVVVVMCMMMMWMMMMM
FFFFFFFFFBBBHBBBBJJJIIIIIIIIIIIIIZZZZZYVVYYVVVVLLLLLBBIIIIPPPPPPPZSSSSSSUUUUUUUUUUUUDDDDDDDPPPPKKKKKKKZZKZZZZZZOOOOOOTTTHHHVHHVMMMMMMMMMLMMM
FFFFFFFFXBBBBBBBBBJJIIIIIIIIIIIIIZZZZNYVYYYYYYVVLLLLIIIIIIIPPPPPPZSSSSESUUUUUUUUUUUUUDDDDPPPPPPKKKKKKKKZZZZZZZZOOOOOOOTTHHHHHHVHCCCCMMMMMMMM
FFFFFFFFFBBBBBBBBBBBIIIIIIIIIIIIIZZZZYYYYYYYYYYVLLILIIIIIIPPPPPPPPPSSSUUUUUUUUUUUUUUUDDDDPPPPPPKKKKKKZZZZZZZOOOOOOTTTTTTAAHHHHHHCCCCCCMMMMMM
FFFFFFFFFBBBBBBBBBBBIIIIIIIIIIIIIZZZZZYYYYYYYYYYYLIIIIIIIIPPPPPPPPPPASUUUUUUBUGUUUUBUJJJJJJJJJJPPKKBZZZZZZZOOOOOTOTTTTTTAAHHHHCCCCCCCCMCMMMM
FFFFFFFFFFBBBBBBBBBBIIIIIIKKZZZZZZZQQYYYYYYYYYYYYIIIIIIIIPPPPPPPPPPPAAUUUUBBBBUUULBBUJJJJJJJJJJPPKKKZZOZZZOOOOOOTTTTTTTTTHHHHHCCCCCCCCCCMMCC
FFFFFFFCWWBBBBBBSBBBIIIIKYKKZZZZZZQQQYYYYYYPYYYIIIIIIIIIIPPPPPPPPPAAAUUUUUVVBBBUUUBBBJJJJJJJJJJPPPKAZZOOOOOOOOOOOTTTTTTLLLHHHHHCCCCCCCCCCMCC
FFFVVVWWBWNWBSSSSBSSIIIIKKKKZZZZZZQQQYYYYYYPPPYIIIIIIIIIIIPPPPPPPPPPAUUAAAVVVVBBBBBBBJJJJJJJJJJPPPOOOOOOOOOOTTOOTTTTTTTLLLLHHHHCCCCCCCCCCCCC
QQFFVVWWWWWWBSSSSSSSSKKKKKKKZZZZZZZZQZZYYYYPPPPIIIIIIIIIIIPPPPPPPPPPAAUAAAVVVBBBBBBBBJJJJJJJJJJPYPOOOOOOOOOOOTTTTTTTTTTTTLLHLHHCCCCCCCCCSSCC
QWFVVVWWWWWWBBSSSSSSSKKKKKKKOOZZZZZZZZZIYYPPPPPVVIIIIIIIIIIPPAPPPAAAAAAAAVVVVBBBBBBBBJJJJJJJJJJPOOOOOOOOOOOOTTTTTTTTTTTTLLLLLLLLLLCCCCCCSSSS
QWVVWWWWWWWWWOSSSSSSKKKKKKKKKKZZZZZZZZZIIPPPPPPVVIIIIIIIIIINPPPAAAAVVAAAAVVVVJJJJBBBBJJJJJJJJJJMMOOOOOOOOOOOTTTTTTTTTTTLLLLLLLLLLLLCCCCCSSSS
WWWWWWWWWWWWWOOSSSSSKKKKKKKKKZZZZZZZZQIIIIPPPPVVDIIIIIIIIIIISSSAAAVVVVVVVVVVVJJJJBBBBJJJJJJJJJJMMNOOOOOOOOOETTTTMTTTTTTLLLLLLLLLLLLLLCSSSSSS
WWWWWWWWWWWWWWSXSSSSKKKKKKKKKKZZZZZZZZIIIIIGGGVVDDIIIIIIIIISSSSASAAVVVVVVVVVVJJJJJJJJJJJJJJJJJJNNNNONNNOOEEETTTTMTTTTTTLLLLLLLLLLLLLASSSSSSS
WWWWWWWWWWWWWWSSSSSSSKKKKKKKZZZZZZZZIIIIIGGGGGGVVVVVVIIVTTTSSSSSSAAAVMSVVVVVVJJJJJJJJJJJJJJJJJJNNNNNNNNOEEEEBBTTMTTTTTTLLLLLLLLLLLLLLLSSSSSS
WWWWWWWWWWWWWWSSSSSSSSKKKZKZZZZZZZIIIIIIIGGGGGVVVVVVVVVVTTTSSSSSSSSSSSSVVVVVVJJJJJJJJJJIIIIINNNNNNNNNNNNNEEEBBTMMTTTTTTTTLLLLLLLLLLLLLMMSSSN
WWKWWWWWWWWWWWWSSSSSHHKKKZZZZZZZZZIIIIIIIGGUGGVVVVVVVVVVVVTTSSSSSSSSSSSVLVVVVJJJJJJJJJJIIIIINNNNNNNNNNNNNEEEEEEMMMTTAAAALLLTTLLLLLLLLLMMMXXN
WWWWWWWWWWWWWWTSJJJSJHKKKYZZZZZZZIIIIIIIGGGVVVVVVVVVVVVVVVVTTSSSSSSSSSLLLVVVVJJJJJJJJJJIIIUINNNNNNNNNNNNNEEEEMMMMTTTAAAALTTUTTTLLLTXXMMMMXXX
WWWWWWWWWWWWWWTJJJJJJHKKYYYZOZZZZZIIIIIGGGVVVVVVVVVVVVVVWVDDDSSSWSSLLSLLLLVVVJJJJJJJJJJLIINNNNNNNNNNNNNNNEEEEEEMMMTMTAAAATTUTTTTLLTTXMMXXXXX
WWWFWWWWWMMMWMJJJJJJJJJYYYYZZZOZIIIIIIIIGGVVVVVVVVVVVVVVWWDDDDDWWSAALLLLLLLLLJJJJJJJJJJLIDNNNNNNNNNNNNSNNEEEEEMMMMMTTAAAATTTTTTTTTTTXXMXXXXX
WFFFMMMMMMMMMMJJJJJJJLJJJYYYYZZIIIIIIIIIIVVVVVVVVVVVMVVDDDDDDDDDDDDAAALLLLLLLLLLLLLLLLLLNNNNNNNNNNNNNNSNNNEFFPTTMTMTTTATATTTTTTTTTTXXXXXXXXF
WFFFMMMMMMMMMMJJJJJJJJJJJYYYYIZIIIIIIIIIZVVVVVVVVVMMMMDDDDDDDDDDDAAAALLLLLLLLLLTTGGLLLNNNNNNNNNNNNSNSJSSTTEFFPTTTTTTTTATTTTTTTTTTTTXXXXXCXFF
WFFFFRRRRRRRJJJJJJJJJJJJJJYYIIIIIIIIIIIVVVVVVVVVVVMMMMDDDDDDDDDDDAATLLLLLLTLLLTTPGGLLLLNNNNNNNSNSSSSSSSSTSFFFPTTTTTTTTTTTTTTTTTTTTXXXXXXXXFF
FFFFFRRRRRRRGJJJJJJJJJJJJJIIIIIIIIIIIIIDVVVVVVVVMMMMMMDDDTTTTDDDTAATTLLLLLTLTTTTGGGLLNNNNGGNSSSSSSSSSSSSSSFFPPTPMTTTTTTTTTTTTTTTTTXXXXXXXXFF
FFFFFFRRRRRRRRUJJJJJJJJJJJIYYYIIYIIIIIIVVVVVVVVMMMMMMDDDDTTTTDDDTTTTTLLLLLTTTTTTTGGGGGGGGGGGSSSSSSSSSSSSSPPPPPPPPPXTTTTTTTTTTTTTTTTXXXEXXXFF
FFFFFFFRRRRRRRRJJJJJJJJYJYYYYYYIIIIIIIMMVMVVVVMMMMMMMDDDDTTTTDDTTTTTTTTLTTTTTTTTTGGGGGGGGGGGSSSSSSSSSSSSPPPPPPPPPPTTTTHHHHHTTYTTWWWXWEEEEEEE
FFFFFFFFFRRRRRRJJJJJJJJYYYYYYYIIIIIJIMMMMMMMVVMMMMMMMDDDDTTTDDRTTTTTTTTTTTTKTTTWWWGGGGGGGGGGGGGSSSSSSSSSPPPPPPPPPPTTTHHHHHHTTYYIYWWWWWWWEEEE
FFFFFRRRFRRRRRRRJJJJJJYYYYYYYYIIIIIJIUUMMMMMMMMMMMEDDDDDDTTTDDDTTTTTTTTTTKKKTTTKKKGGGGGGGGGVGGGSSSSSSSSSPPPPPPPPPPPHHHHHHHHYYYYYYWWWWWWWWEEE
QFFFMRRRRRRRRRRRRRQQQJJYYYYYYYYIIIIUUUUUUUUUMMMMMEEEEEEDDTTTDDDDTTTTTTTTTKKKKKTKKKKKGGGGGGVVVVSSSSSSSSSSPPPPPPPPPPPHHHHHYYYYYYYYYWWWWWWWWWED
QFMMMRRRRRRRRRRRRRRQYYYYYYYYYYYYYYYUUUUUUUUUMMEEEEEEEEEETTTTDDDDDTTTTTTTKKKKKSKKKKKKGGGVVVVVVVVWSSSSSSSSSSPPPPPPPPHHHHHHYYYYYYYYYWWWWWWWWWWW
QQQQQRRRRRRRRRRRRRRRYYYYYYYYYYYYYYUUUUUUUYUUUMEEEEEEEEEETTTTDDDKJJJJTTTTKKKKKKKKKKKKGGGVVVVVVVVWWSSSSSSSSSPPPPPPPPPHHHYYYYYYYYYYYYWWWWWWWWWW
QVVVQCRRRRRRRRRRRRRRYYYYYYYYYYYYYUUUUUUUUUUMMMEEEEEEEEEETTTTDRDKJJJJTTTTKKKKKKKKKKKKGGGGZVVVVVVWWWSMMSSSSSPPPPPPPPHHHHYYYYYYYYYYYYYWWWWWWWWW
VVVVVRRRRRDRRRRRRRRRYYYYYYYYYYYYUUUUUUUUUUUMMMEEEEEEEEEETTTRRRRRJJJJJJJTTKKKKKKKKKKKHGGZZVVQUXWWWWWMMMMMSSPPPPPPPPHHHYYYYYYYYYYYYYYWWWWWFWWP
VVVVRRRRRDDDRRRVRYYYYYYYYYYYYYYYYYYUUUUUUMMMMEEEEEEEEEEETTTRRRRVJJJJJJJTTQQKKKKKKKFKHHQQQQQQXXWWWWWWUMMMSPPPPPPPPPHHHHYYYYYYYYYYYYWWWWWWFWWP
VVVVVNNDDDDRRRRVVYYYYYYYYYYYYYYYYYYEUUUUUMMMMEEEEEEEEEEEERRRRRRVJJJJJJJQQQQQKKKKKKKZKHHQQQQXXXWXWWWUUMMMMPPPPPLLPPLLHHYYYYYYYYYYYJWWWWFFFWFS
VVVVVNNNDDVYRVVVVYYYYYYYYYYYYYYEEEEEEUUUUUMMMMEEEEEEEEEEEEERRRRRJJJJJJJQQQQQKKKKKKKKKKQQQQQXXXXXWWUUUPPPPPPPPPLLLLLLHLYYYYYYYYYYYWWWSGGFFFFS
VVVVVVNNDNVVVVVVVVVVYYYYYXYYYYYYEEEEEEUUMMMMMMEEEEEEEEEEEEQQQQRRJJJJJJJQQQQQKKKKKKKKMQQQQQQXXXXXXXUUUPPPPPPPPPPLLLLLLLLLLYYYYKYYYWISSGGGFFFS
VVVVVVNNNNVVVVVVVVVVVYYCXXYYYXYYEEEEEEEEEMMMMMEEEEEXEEREQQQQQQQVJJJJJJJQQQQPPKKKKKKKKQQQQQQXXXXXXXXXUXXPPPPPPPPLLLLLLLLLYYYYYKYYYYYSGGSSSSFS
VVVVVNNNNNFFVVVVVVVVVJJXXXXXXXXYYEEEEEEEMMMMMMMMMEEXXQQQQQQQQQQVJJJJJJJQQQQQKKKKKKKXXQQQQQXXXXXXXXXUUXXQQPPPPPPPLLLLLLLLKKKKKKKKYVSSSSSSSSSS
VVEVVINNNNFFFVVVVVVFFXXXXXXXXXYYYEEEEEEEEDDDDMDCMKKXXXQQQQQQQQQQJJJJJJJQQQQQKKKKKKXXXQQQXXXXXXXXXBBIXXXQQQPXSPPLLLLLLLLLKKKKKKKKSSSSSSSSSSSS
IIIIIIINNNFFFFFFFFFFXXXXXXXXXXXXYEEEEEEEDDDDDDDCKKKXXXQQQQQQQQQQJJJJJJJQQQQQKKKKKKXXXXXXXXXXXXXXBBBXXXXQQQSSSPPLLLLLLLLLKKKKKKKSSSSSSSSSSSSS
IIIIIINNNNFFFFFFFFFXXXXXXXXXXXXXEEEEEEEDDDDDDDDCKKKKXXQQQQQQQQQQQQQDQQQQQQXQKKKKXXXXXXXXXXXXXXXXBBBVXXXXQQSSSSYYLLLLLLLLKKKKKKKSSSSSSSSSSSSS
IIIIIIIIIFFFFFFFFFFFXXXXXXXXXXXXEEEEEEEEDDDDDDDDDKKQQQQQQQQQQQQQQQQDQQQQNQXQXXKXXXXXXXXXXXXXXXXXXXBXXXXXSSSSSSSYSSLLLILLKIIIKKKKKSSSSSSSSSSS
IIIIIIIIIZFFFFFFFFFXXXXXXXXXXXXXEEMEEEEDDDDDDDDKKKKQKQQQQQQQQQQQQQQQQQQQQQXXXXXXXXXXXXXXXXXXXXXXXXGXXXXXSSSSSSSSSIIIIIIIIIIIKKKKKKKKSSSSSSSS
IIIIIIIIIZZZOOOOFFFXXXXXXXXXXXXXMEMEEEEHDDDDDDDDDKKKKQQQQQQQQQQQQQQCQYYYYQMXXXXXXXXXXXXXXXXXFFXXXXXXXXXXSSSSSSSIIIIIIIIIIIIIKKKKKKKKSSSSSSSS
IIIIIIIIIZZZOOMMFFFFXXXXXXXXXMMMMMMREEEHHHDDDDDDDKKKKKQQQQQQQQQQQQDDDYDDDLMXXXXMXXXXXXXXXXXXFFXXXXXXXXXSSSSSSSUIIIIIIIIIIIIIKKKKKKKSSSSSSSSS
IIIIIIIIIZZZOOOOOOFFXXXXXXXXXMMMMMMMMEHHHDDDDDDDDKKKKIQQQQQQQQQQQQDDDDJDLLMMMMMMMMMMXXXXXXXXFFFXXXXXXXXSSSSSSSSIIIIIIIIIIIIIIIKKKKKKSSSSSSSD
IIIIIIIIZZZOOOOOOOFFXXXXXXXXXMMMMMMMHHHHHDDDDDDDDDKKKIQQQQQQQQQQQQDDDDDDDDMMMMMMMMMMXXYXXXXXFFFXXXXXXSSSSSSSSSSSSIIIIIIIIIIIIIKKKKKKBSSSKSDD
IIIIIIIIIZZOOOOOOOOFFXXXXXXXMMMMMMMMHHHKHKDDDDDKKKKKIIIIKICIQQAQQADDDDDDDMMMMMMMMMMMMYYXXXXFFFXXXXXXXXXSSBSSSSSSSIIIIIIIIIIIIKKKKKKKKZSSSDDD
IIIIIHIIZZZOOOOOOFOFFFFXXXXXMMMMMMMMMHHKKKDDDDDDKKKKIIIIIIIIQIILIIDDDDDMMMMMMMMMMMMMFYYYYXXXXXXXXXXXXXXSSSSSSSSSSIIIIIIIIIIIIIKKKKKKZZSSSDDD
SSIIIHHHHZHOOOOOFFFFFFXXXXXMMMMMMMMMMHHKKKDDDDDKKKKIIIIIIIIIIIIIIIDDDDDDMMMMMMMMMMMFFYYYYVVVVXXXXXXXXXXXSSSSSSSSSIIIIIIVVIITIIIIKKZZZZSSXDDD
SIISSHHHHHHOOOOOOOFFFFXXXXXXLMMMMMMMMHHKKKDDKDKKKKKKIIIIIIIIIIIIDDDDDDDMMMMMMMMRMFFFFYYVVVVVVVXXXXXXXXXMSSSSSSSSSSIIIIIVIITTITTIEZZFFZBBXDDD
SSISSSSHHHOOOOOOOFFFFFFXXXXLLMMMMMMHHHHKKKKKKKKKKKKIIIIIIIIIIIIDDDDDDDDMMMMMMMRRMFFFFYYVVVVVVVXXXXXXAAASSSSSCSSSSVVIVVVVQVTTITTTEEZZFFBXXDDX
SSSSDDDHHHDDDOOOOOXFFFFFXXXXLLMMMMMHSHHKKKKKCKKKKKKKIIIIIIIIIIIIDDDDDDMMMMMMMMMRMMFFFFVVVVVVVVVXXXXXXAASSSSSSFFSAVVVVVVVVVVTTTTEEEEFFFBXXDXX
SSSSDDDDHHDOOOOODDXFFFFFXXXXXXXMQSHHSSHCCDCCCKKKKKKKIIIIIIIIIIIIDDDDBBMMMMMMMMMMMMFFFFVVVVVVVVTTXXXDAAAAASSSSFASAVVVVVVVVVVVVVTEOEEBFBBXXXXX
SSSSDDDDHHDDDDDDDDXXXXXXXXXXXXXSSSSSSSHCCDDCCKKKKKKKIIIIIIIIIIBDDBBBBBMMMBBMMMMMMFFFFFVVVVVVVTTTTXGTTAAAAAAASAAAAVVVVVVVVVVVVEEEEEEBBBXXXXXX
SSSWWWDDDDDDDDDDDXXXXXXXXXXXXXSSSSSSSSSSCCCCCCCKKKKKKIIIIIIIAABBBBBBBBBMMBBBMMMMMMFFFVVVVVVTTTTTTTTTTTAAAAAAAAAAAAVVVVVVVVVVVVEEEEEEBBXXXXXX
SSSWWWWDDDSDDDDDDDXXXXXXXXXXXXSSSSSSSSSSCCCCCCCCKKKOOOXIIIOAAAAAABBBBBBMMBBBMMMFFFFFFFVVVVHTTTTTTTTTTTTAAAAAAAAAAZVVVVVVVVVVVVBEEEBBBBBXXXXX
SSSWWLLSSSSDDDSSDMMMMXXXXXXXXXSSSSSSSSSSSCCCCCCCCKKOOOOIIIOAAAAAABBBBBBBBBBBMBFFFFFFFFVVVVVFFTTTTTTTTTTTAAAAAAAAAAVVVVVVVVVVVVBBBBBBBBBXXXXX
SSSSWSSSSSDDDSSSMMMMXXXXXXXXXXJSJSSSSSSSSCCCCCCCKKKOOOOOOOOOOAAAABBBBBBBBBBBBBFFFFFFFFFFFFFFTTTTTTTTTTTTFFAAAAAAAAVVVVVVVVVVVVVBBBBBBBBXXXXX
SSSSSSSSSSSSSSSMMMMMMMXXXXXXXJJJJSSSSSSSSCCCCCCCKKOOOOOOOOOOOAAAABBBBBBBBBBBBBFFFFFFFFFFFFFFTTTTTTTTTTTFFFFAAAAAAAAAVVVVVVVVVVBBBBBBBBBXXXXX
SSSSSSSSSSSSSSSMMMMMMMXXXVXXXJJJJSSSSSSSSCCCCCCKKKKOOOOOOOOOOAAAABBBBBBBBBBBBBFFFFFFFFFFFFTFFTTTTTTTTTFFFFFAAAAAAAAAVVVVVVVVBBBBBBBBBBBBBXXX
SSSSSSSSSSSSSSSMMMMMMMXXXVVXJJJJJSSSSSSSCCCCCCCKKKOOOOOOOOOOOAABBBBBBBBBBBBBBBFFFFFFFFFFFTTTTTTTTTTTTTFFFFFFKAAAAAAAVVVVVVVVVBBBBBBBBBBBBBBX
SSSSSSSSSSSSSSKMMMMMMMMMMVVXXPPJSSSSSSSSSSSCCCCCCKOOOOOOOOOOAAAABBBBBBBBBBBBBBFFFSFFFFFFFTTTTTTTTTTTTTFFFFFAAAAAAAAAUVVVVVVVBBBBABBBBBBBBBBB
SSSSSSSSSSSSSSSSMMMMMMMMMMMKXPPPSSSSSSSSSSSSKCOCKKKKKZOOOOOOOAAAAABBBBBBBBBBQBFFSSSSFFFFFFTTTTTTTTTTTTFFFFFFASSSAAUUUVVVVBBBBBBAABBABBBBBBBB
IISSSSSSSSSSSSSSMMMMMCMMMWMKKPPPPPPSAASSSSSSKCKKKKKKKZOOOOOAAAAAAABBBBBBBBBBBBFSSSSSFFFFFFTFTTTTTTTTTTFFFFFFFFFFUUUUUUVUUBBBBBBAAAAAAAAABBBB
IISISSSSSSSSSSSMMMMMMCNCWWWNNNPPPPAAAASSSSSCKCCKKKKKAZOLOAAAAAAAAAAABBBCCBBSFFFSSSSSFFFFFFFFFFFTTTTTTTFFFFFFFFFFFUUUUUVVUUUBBBROAAAAAABBBBBB
IIIIISSSSUUSSOSMMMMCCCNCWWWNNNPPNPNNAASSSSSCCCCCHHKHAAAAOAAAAAAAAAABBBBCCCSSSSSSSSSSSFFFFFFFFFFFKTTTTTFFFFFFFFFFFUUUUUUUUUUUURRRRAAAAABBBTTT
IIISSSSUUUUUSUMMMMMCCCCCCWWNNNNPNXNAASSSSSSCCCCCCHKHAAAAAAAAAAAAAAAAABBBSSSSSSSSSSSSSFFFFFFFFFFKKKFFFFFFFFFFFFFFFUUUUUUUUUUURRRRBAAAAAAATTTT
IIISISSUUUUUUUMMMMCCCCCCCCCCNNNNNNNNNSSSSCCCCCCCCHHHHAAAAAAAAAAAAAAAAAGBISSVVSSSSSSSFFFFFFFFFFFFFFFFFFFFFFFFFFFFFUUUUUUUURRRRRRRRRRRAAAAATTT
IIIIIIUUUUUUUUMUMMCCCCCCCCYNNNNNNNNSSSSSSSCCCCCHHHHHHHHAAAUAAAAAAAAOAABBBVVVVVSSSSSSSFFFFFFFFFFFFFFFZFFFFFFFFFFFFUUUUUUUUURRRRRRRRRRAATTTTTT
PPPIPPIUUUUUUUUUMCCCCCCCCCCNNNNNNNNSSSSSSSSCCCHHHHHHHHUUUUUUUAAAAAGOGABBBBDDDVSYFFSFFFFFFFFFFFFFFFFFZFFFFFFFFFFFUUUUUUUURRRRRRRRRRRAATTTTTTT
PPPPPPUUUUUUUMMMMMMCCCCCCCCCNNNNNNNNMMSSSSSCCCTHHUUHHHUUUUUUUUAAAAGOGBBBBDDDDDFYYFFFFFFFFFFFFFFFFFZZZZZZFFFFFFFFFUUUUUUURRRRRRRRRRRAAAATTTTT
PPPPPPUUUUUUUUMMMMCCCCCCCCCCCNNNNNMMMMMSSSSCQTTTTUUUUUUUQUUUUUAAAGGGGBBBBDDDDFFFFFFFFFFFFFHHHFFFZZZZZZZZZFFFFFFFFUUUUUUUURRRRRRRRRRAAAAATTTT
PPPPPPPUPUUUUAMMMMCCCCCCCCCNNNNNNNMMMMMMSSSSTTTTUUUUUUUUUUUUUUAAGGGGBDDDDDDDDFFFFFFHHFFHHHHHZZZFZZZZZZZYYOOOFFUUUUUXXXXURRRRRRRRRRRRCCAATTTT
PPPPPPPPPUPUUPPMMMCCCCCCCCCCNNNNNNMMMMMMMSSSTTTTUUUUUUUUUUUUUUGGGGGGDDDDDDDDDDDDDDDHHHFFHHHHHHZZZZZZZYYYYOYOFFUUUUUXXXXXXRRRRRRRRRCCCCAAAAAA
PPPPPPPPPPPPPPTMMMGCCCCCCCCCNNNNNNMMMMMMSSTTTTTTTFUUUUUUUUUUUGGGGGGGDDDDDDDDDDDDDDHHHHHFHHHHHZZZZZZZYYYYYYYYUUUUUUXXXXXXXXRRRRRRRRCCCCCAAAAA
PPPPPPPPPPPPPPPGGGGGCCCCCCCCNNNNNNNMMMSMSSTTTTTTTTTUUUUUUUUUUVGGGGGGDDDDDDDDDDDDDDHHUHHHHHHHHHZZZZZZYYYYYYYUUUUUUUXXXXXXXRRRRRRRRRCCCCCCAAAA
GPPPPPPPPPPPPPPGGGGGGCCCCCHNNNNNHHHMMSSSSTTTTTTTTTUUUUUUUUUGGGGGGGGGGDDSDDDDDDDDDDDHHHHHHHHHHHZZZZZYYYYYYYYUUUUUXXXXXXXXXRXXXRRRCCCCCCCAAAAA
PPPPPPPPPPPPPPPGGGGGGCCCHHHNNNNNHMMMMMMSSTTTTTTTTTTTUUUUUVVGGGGGGGGGGDDDDDDDDDDDDDHFHHHHHHHHHHZZZYZYYYYYYYYYYUXXXXXXXXXXXXXXXXRRRRBCCCCAAAKA
PPPPPPPPPPPPPPGGGGGGGCGHHHHNNNNNHMMMMMMTTTTTTTTTTTTTTUUUUUUGGGGGGGGGGGDDDDDDDDDDDDHHHHHHHHHHZZZZZYYYYYYYYYYYYUXXXXXXXXXXXXXXXXRRRRCCCCCAAAAA
PPPPPPPPPPPPGGGGGGGGGGGHHHHHHHNNHHMMMMMSTTTTTTTTTTTTTTUUTWUGGGGGGGGGGGDDDDDDDDDDDDHHHHHHHHHHHHZZZYYYYYYYYYYYYYZXXXXXXXXXXXXXXOORORCCCCCCOOOO
PPPPPPPPPPPPPGGGGGGGGGGGGHHHHHNHHMMMMMMSSTTTTTTTTTTTTTTUTWWGGGGGGGGGDDDDDDDDDDDDDDDHHHHHHHHHHZZZZYYYYYYYYYYYMYXXXXXXXXXXXXXXOOOROOOOOOOOOOOO
RRPYPRPPPPPPPGGGGGGGGGGGGGHHHHHHHHHMFMSSSTTTTTTTTTTTTTTTTTTYYGGGGGGGDDDDDDDDDDDDDHHHHHHHHHHHHZZZZZYYYYYYYWYMMXXXXXXXXXXXXXXXOOOOOOOOOOOOOOOO""")
# Part 2 examples
panel_5 = Panel("""EEEEE
EXXXX
EEEEE
EXXXX
EEEEE""")
panel_6 = Panel("""AAAAAA
AAABBA
AAABBA
ABBAAA
ABBAAA
AAAAAA""")
# examples from reddit
panel_7 = Panel("""AAAAAAAA
AACBBDDA
AACBBAAA
ABBAAAAA
ABBADDDA
AAAADADA
AAAAAAAA""")
# to be 164
panel_8 = Panel("""CCAAA
CCAAA
AABBA
AAAAA""")
# to be 307122
panel_9 = Panel("""XOXOXOXOXOXOXOXOXOXOXOXOXOXOXOXOXOXOXOXOXOXOXOXOXOXOXOXOXOX
OXXXXXXXXXXXXXXXXXXXXXXXXXXXXXXXXXXXXXXXXXXXXXXXXXXXXXXXXXO
XXXXXXXXXXXXXXXMXXXMXEEEEEXRRRRXXRRRRXXYXXXYXXXXXXXXXXXXXXX
OXXXXXXXXXXXXXXMMXMMXEXXXXXRXXXRXRXXXRXYXXXYXXXXXXXXXXXXXXO
XXXXXXXXXXXXXXXMXMXMXEEEEEXRRRRXXRRRRXXXYXYXXXXXXXXXXXXXXXX
OXXXXXXXXXXXXXXMXXXMXEXXXXXRXXXRXRXXXRXXXYXXXXXXXXXXXXXXXXO
XXXXXXXXXXXXXXXMXXXMXEEEEEXRXXXRXRXXXRXXXYXXXXXXXXXXXXXXXXX
OXXXXXXXXXXXXXXXXXXXXXXXXXXXXXXXXXXXXXXXXXXXXXXXXXXXXXXXXXO
XXXXCCCXXHXXXHXRRRRXXIIIIIXXSSSSXTTTTTXMXXXMXXAAAXXXSSSSXXX
OXXCXXXCXHXXXHXRXXXRXXXIXXXSXXXXXXXTXXXMMXMMXAXXXAXSXXXXXXO
XXXCXXXXXHHHHHXRRRRXXXXIXXXXSSSXXXXTXXXMXMXMXAAAAAXXSSSXXXX
OXXCXXXCXHXXXHXRXXXRXXXIXXXXXXXSXXXTXXXMXXXMXAXXXAXXXXXSXXO
XXXXCCCXXHXXXHXRXXXRXIIIIIXSSSSXXXXTXXXMXXXMXAXXXAXSSSSXXXX
OXXXXXXXXXXXXXXXXXXXXXXXXXXXXXXXXXXXXXXXXXXXXXXXXXXXXXXXXXO
XOXOXOXOXOXOXOXOXOXOXOXOXOXOXOXOXOXOXOXOXOXOXOXOXOXOXOXOXOX""")
characters = Characters(Text=panel_9)  # -> simplify(Result), Unicode
# to be 946
c_script = CSharpScript(CharTree=characters.Result)  # -> out, coordinates, character; inputs CharTree: tree of String
# ---------- c_script: C# ----------
// Grasshopper Script Instance
#region Usings
using System;
using System.Linq;
using System.Collections;
using System.Collections.Generic;
using System.Drawing;

using Rhino;
using Rhino.Geometry;

using Grasshopper;
using Grasshopper.Kernel;
using Grasshopper.Kernel.Data;
using Grasshopper.Kernel.Types;
#endregion

public class Script_Instance : GH_ScriptInstance
{
    #region Notes
    /* 
      Members:
        RhinoDoc RhinoDocument
        GH_Document GrasshopperDocument
        IGH_Component Component
        int Iteration

      Methods (Virtual & overridable):
        Print(string text)
        Print(string format, params object[] args)
        Reflect(object obj)
        Reflect(object obj, string method_name)
    */
    #endregion

    private void RunScript(
	DataTree<string> CharTree,
	ref object coordinates,
	ref object character)
    {
    List<Point3d> centers = new List<Point3d>();
    List<string> characters = new List<string>();

    int maxHeight = CharTree.BranchCount;

    // Iterate over each branch of the tree
    for (int i = 0; i < CharTree.BranchCount; i++)
    {
        List<string> currentBranch = CharTree.Branch(i);

        // Iterate over each item in the current branch
        for (int j = 0; j < currentBranch.Count; j++)
        {
            double x = j + 0.5;
            double y = maxHeight - i - 0.5;

            // Create a point at the center of the rectangle
            Point3d center = new Point3d(x, y, 0);
            centers.Add(center);
            characters.Add(currentBranch[j]);
        }
    }

    // Set output variables
    coordinates = centers;
    character = characters;
    }
}
# ---------- end c_script ----------
xy_plane = XYPlane(Origin=c_script.coordinates)
rectangle = Rectangle(Plane=xy_plane, XSize="-0.5 to 0.5", YSize="-0.5 to 0.5", Radius=0)  # -> Rectangle, Length
create_set = CreateSet(List=flatten(c_script.character))  # -> Set, Map
list_length = ListLength(List=create_set.Set)
boundary_surfaces = BoundarySurfaces(Edges=rectangle.Rectangle)
create_tree = CreateTree(Data=boundary_surfaces, Path=create_set.Map)
gradient = Gradient(
    LowerLimit=0,
    UpperLimit=list_length,
    Parameter=create_set.Map,
    stops=[0: RGB(48, 18, 59), 0.0312: RGB(57, 41, 114), 0.0625: RGB(64, 64, 161), 0.0938: RGB(68, 86, 199), 0.125: RGB(70, 107, 227), 0.156: RGB(70, 127, 246)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])  # disabled
brep_join = BrepJoin(Breps=create_tree)  # -> Breps, Closed
list_length_2 = ListLength(List=flatten(brep_join.Breps))
brep = Brep(flatten(brep_join.Breps))
series = Series(Start=0, Step=1, Count=list_length_2)
custom_preview = CustomPreview(Geometry=boundary_surfaces, Material=gradient)  # disabled
brep_edges = BrepEdges(Brep=brep_join.Breps)  # -> Naked, Interior, NonManifold
gradient_2 = Gradient(
    LowerLimit=0,
    UpperLimit=list_length_2,
    Parameter=series,
    stops=[0: RGB(48, 18, 59), 0.0312: RGB(57, 41, 114), 0.0625: RGB(64, 64, 161), 0.0938: RGB(68, 86, 199), 0.125: RGB(70, 107, 227), 0.156: RGB(70, 127, 246)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])
curve = Curve(brep_edges.Naked)
area = Area(Geometry=brep_join.Breps)  # -> graft(Area), Centroid
join_curves = JoinCurves(Curves=curve, Preserve=False)
length = Length(Curve=join_curves)
custom_preview_2 = CustomPreview(Geometry=brep, Material=gradient_2)
mass_addition = MassAddition(Input=length)  # -> Result, PartialResults
panel_10 = Panel(area.Area)
multiplication = Multiplication(A=mass_addition.Result, B=area.Area)
panel_11 = Panel(mass_addition.Result)
number_slider = Slider(-1, range=-2..0)
explode = Explode(Curve=join_curves, Recursive=True)  # -> Segments, Vertices
mass_addition_2 = MassAddition(Input=flatten(multiplication))  # -> Result, PartialResults
number_slider_2 = Slider(1, range=0..10)
panel_12 = Panel(multiplication)
tree_statistics = TreeStatistics(Tree=brep_join.Breps)  # -> Paths, Length, Count
list_item = ListItem(List=tree_statistics.Paths, Index=Slider(0, range=0..100), Wrap=True)
shift_paths = ShiftPaths(Data=explode.Segments, Offset=Slider(-1, range=-1..0))
panel_13 = Panel(mass_addition_2.Result)
tree_branch = TreeBranch(Tree=brep_join.Breps, Path=list_item, MaintainPaths=True)
list_item_2 = ListItem(List=tree_branch, Index=number_slider_2, Wrap=True)
list_item_3 = ListItem(List=tree_branch, Index=number_slider_2, Wrap=True)
panel_14 = Panel("""884354
was too low""")

# ----
# Part2
discontinuity = Discontinuity(Curve=join_curves, Level=1)  # -> Points, Parameters

curveshatter = CurveShatter(Curve=join_curves, Points=discontinuity.Points, Tolerance=0.01)
shift_paths_2 = ShiftPaths(Data=curveshatter, Offset=Slider(-2, range=-10..-2))
shatter = Shatter(Curve=join_curves, Parameters=discontinuity.Parameters)
list_length_3 = ListLength(List=discontinuity.Parameters)
shift_paths_3 = ShiftPaths(Data=list_length_3, Offset=number_slider)
shift_paths_4 = ShiftPaths(Data=discontinuity.Points, Offset=number_slider)
tree_statistics_2 = TreeStatistics(Tree=shift_paths_4)  # -> Paths, Length, Count
list_item_4 = ListItem(List=tree_statistics_2.Paths, Index=number_slider_2, Wrap=True)
shift_paths_5 = ShiftPaths(Data=shatter, Offset=Slider(-2, range=-10..-2))
mass_addition_3 = MassAddition(Input=shift_paths_3)  # -> Result, PartialResults
panel_15 = Panel(list_length_3)
tree_branch_2 = TreeBranch(Tree=shift_paths_4, Path=list_item_4, MaintainPaths=True)
panel_16 = Panel(mass_addition_3.Result)

multiplication_2 = Multiplication(A=mass_addition_3.Result, B=area.Area)
mass_addition_4 = MassAddition(Input=flatten(multiplication_2))  # -> Result, PartialResults
panel_17 = Panel(mass_addition_4.Result)
